# Grasshopper definition Emu_AngledCantilever.gh (Grasshopper 1.0.7)
# plug-ins: Emu Grasshopper

results_to_visualize = ValueList({"MXX": 0, "MYY": 1, "MZZ": 2, "MTOT": 3}, selected="MXX")
vertical_load_at_tip_n = Slider(4325, range=4325..43250)
run_simulation = BooleanToggle(False)
# Non-linear analysis of clamped beam
# Using Emu Structural solver
# Instructions
# 1. Press play on the timer
# 2. Set "Run simulation" to true. This will start the solver.
# 3. Change the "Result to visualize" value list to study moments about different axes.
# 4. Change the vertical load at tip to see moments redistribute.
# Start here
timer = Timer(Interval=10, TimerInterval=10, Target=dynamicrelaxationlive)  # disabled
run = Boolean(run_simulation)
int = Integer(results_to_visualize)
num = Number(vertical_load_at_tip_n)

# ----
# GENERATING LINES
crv = Curve(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)
crv_2 = Curve(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)
end = EndPoints(Curve=crv)  # -> Start, End
end_2 = EndPoints(Curve=crv_2)  # -> Start, End
# BENCHMARK TEST
# TWISTED BEAM
# EMU Structural solver 1.0.0
# By Emil Poulsen
number_slider = Slider(4, range=0..10)
divide = DivideCurve(Curve=[crv, crv_2], Count=number_slider, Kinks=False)  # -> Points, Tangents, Parameters
pline = PolyLine(Vertices=divide.Points, Closed=False)
explode = Explode(Curve=pline, Recursive=True)  # -> flatten(Segments), Vertices

# ---- group: Visualize clamped support
crv_3 = Curve(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)
boundary = BoundarySurfaces(Edges=crv_3)

# ----
pt = Point(end_2.End)
pt_2 = Point(end.Start)
num_2 = Number(num)
amplification = Slider(1, range=0..5)
amplification_num = Number(amplification)
# SHOW NUMERICAL RESULTS
amplification_num_2 = Number(amplification_num)
plugininfo = PluginInfo()
panel = Panel(plugininfo)

pt_3 = Point(pt_2)
pt_4 = Point(pt)
item = ListItem(List=pt_3, Index=0, Wrap=True)
# DEFINING MODEL
number_slider_2 = Slider(1, range=0..1)
Z = UnitZ(Factor=num_2)
toggle = BooleanToggle(True)
neg = Negative(Value=Z)
num_3 = Number("7800")
num_4 = Number("210*10^9")
num_5 = Number("78*10^9")
beamelement = BeamElement(Line=explode.Segments, Material=number_slider_2, CrossSection=number_slider_2, Group=number_slider_2)
hollowboxsection = HollowBoxSection(Index=Slider(1, range=0..1), Height="0.2", Width="0.1", Thickness="0.01")  # -> Section, Area, SecondMomentOfAreaAroundX, SecondMomentOfAreaAroundY, MomentOfInertiaTorsion
const = Constraint(
    Point=item,
    TranslationalX=toggle,
    TranslationalY=toggle,
    TranslationalZ=toggle,
    RotationalX=toggle,
    RotationalY=toggle,
    RotationalZ=toggle)

custommaterial = CustomMaterial(Index=Slider(1, range=0..1), Density=num_3, YoungsModulus=num_4, ShearModulus=num_5)
pointload = PointLoad(Position=pt_4, Force=neg, Index=0)

model = Model(
    Elements=beamelement,
    CrossSections=hollowboxsection.Section,
    Materials=custommaterial,
    Loads=pointload,
    Constraints=const,
    Rebuild=Button())  # -> Model, Weight_kg

# ----
# SOLVE SYSTEM
number_slider_3 = Slider(1.935, range=0..4)
number_slider_4 = Slider(480, range=0..1000)
list = ValueList({"SymplecticEuler": 0, "RungeKutta": 1}, selected="SymplecticEuler")
intprop = IntegrationProperties(
    Mass=number_slider_3,
    DeltaTime=number_slider_3,
    Damping=Slider(0.95, range=0..1),
    IntegrationMethod=list,
    IterationsPerStep=Slider(267, range=0..1000),
    EquilibriumThreshold=0.001)
run_2 = Boolean(invert(run))
dynamicrelaxationlive = DynamicRelaxationLive(FiniteElementModel=model.Model, IntegrationProperties=intprop, Reset=run_2)  # -> Model, OutOfBalanceForce, OutOfBalanceMoment, MaxDisplacement_m
data = Data(dynamicrelaxationlive.Model)

amplification_num_3 = Number(amplification_num)
data_2 = Data(data)
geometryviewer = GeometryViewer(FiniteElementModel=data_2, Amplification=amplification_num_3)  # -> Nodes, Lines

# ----
# EXTRACT RESULTS
number_slider_5 = Slider(2, range=0..10)
amplification_num_4 = Number(amplification_num)
data_3 = Data(data)
int_2 = Integer(int)
diagramviewer = DiagramViewer(
    FiniteElementModel=data_3,
    TResult=int_2,
    Scale=Slider(1, range=-1..1),
    NumDataPoints=number_slider_5,
    Amplification=amplification_num_4)  # -> Diagram, Values, Loft

num_6 = Number(diagramviewer.Values)

# ----
# COMPARE W/ CALFEM & MATLAB
crv_4 = Curve(geometryviewer.Lines)
lng = ListLength(List=crv_4)
addition = Addition(A=lng, B=-1)
item_2 = ListItem(List=crv_4, Index=addition, Wrap=True)
end_3 = EndPoints(Curve=item_2)  # -> Start, End
diagramviewer_2 = DiagramViewer(
    FiniteElementModel=data,
    TResult=Slider(2, range=0..10),
    Scale=Slider(-0.24, range=-1..1),
    NumDataPoints=2,
    Amplification=1)  # -> Diagram, Values, Loft; disabled
pt_5 = Point(end_3.End)
pdecon = Deconstruct(Point=pt_5)  # -> XComponent, YComponent, ZComponent
item_3 = TreeItem(Tree=num_6, Path="{0}", Index=0, Wrap=True)
emu_moment_at_clamp = Panel(item_3)
matlab_moment_at_clamp = Panel("21425")
matlab_deflection_at_tip = Panel("-0.3899")
emu_deflection_at_tip = Panel(pdecon.ZComponent)
division = Division(A=emu_moment_at_clamp, B=matlab_moment_at_clamp)
division_2 = Division(A=emu_deflection_at_tip, B=matlab_deflection_at_tip)
ratio = Panel(division)
ratio_2 = Panel(division_2)

data_4 = Data(data)
# SHOW NUMBERS
run_3 = Boolean(run_2)
elemforceviewer = ElementForceViewer(FiniteElementModel=data_4, ElementIndex=0, Stations=2)  # -> Forces, Moments, Normal, Coord
sectionviewer = SectionViewer(FiniteElementModel=data_4, Amplification=amplification_num_2)
data_5 = Data(elemforceviewer.Moments)
vlen = VectorLength(Vector=data_5)
pdecon_2 = Deconstruct(Point=data_5)  # -> XComponent, YComponent, ZComponent
neg_2 = Negative(Value=vlen)
data_6 = Data(diagramviewer.Values)
sort = SortList(Keys=flatten(data_6))  # -> Keys, ValuesA
item_4 = ListItem(List=reverse(sort.Keys), Index=0, Wrap=True)
item_5 = ListItem(List=sort.Keys, Index=0, Wrap=True)
gradient = Gradient(
    LowerLimit=item_5,
    UpperLimit=item_4,
    Parameter=data_6,
    stops=[0: RGB(0, 0, 255), 0: RGB(0, 0, 255), 0.236: RGB(0, 255, 255), 0.497: RGB(0, 255, 0), 0.751: RGB(255, 255, 0), 1: RGB(255, 0, 0)])
panel_2 = Panel(item_5)
panel_3 = Panel(item_4)
filter = StreamFilter(Gate=run_3, Stream0=gradient, Stream1=ColourSwatch(SwatchColor=RGB(166, 166, 166)))
mcol = MeshColours(Mesh=sectionviewer, Colours=filter)

# ---- group: plot diagram
swatch = ColourSwatch(SwatchColor=RGB(0, 200, 255))
crv_5 = Curve(diagramviewer.Diagram)
brep = Brep(diagramviewer.Loft)
num_7 = Number(diagramviewer.Values)
material = CreateMaterial(
    Diffuse=ColourSwatch(SwatchColor=RGB(255, 255, 255)),
    Specular=swatch,
    Emission=swatch,
    Transparency=Slider(0.564, range=0..1),
    Shine=0)
preview = CustomPreview(Geometry=brep, Shader=material)
_10º = PowerOf10(Value=Slider(3, range=0..10))
panel_4 = Panel("100")
division_3 = Division(A=num_7, B=_10º)
preview_2 = CustomPreview(Geometry=crv_5, Shader=ColourSwatch(SwatchColor=RGB(255, 255, 255)))
item_6 = ListItem(List=crv_5, Index=2, Wrap=True)  # -> Item, Item1
curvepoint = PointOnCurve(item_6.Item1, parameter=0.274)
curvepoint_2 = PointOnCurve(item_6.Item1, parameter=0.742)

# ----
multiplication = Multiplication(A=division_3, B=panel_4)

# ---- group: plot diagram (continued)
round = Round(Number=multiplication)  # -> Nearest, Floor, Ceiling
division_4 = Division(A=round.Nearest, B=panel_4)
concat = Concatenate(FragmentA=division_4, FragmentB=" kNm")
tag = TextTag(Location=[curvepoint, curvepoint_2], Text=concat, Colour=ColourSwatch(SwatchColor=RGB(0, 0, 0)))
