# Grasshopper definition Emu_ElasticGridshellFormation.gh (Grasshopper 1.0.5)
# plug-ins: Emu Grasshopper

# EMU STRUCTURAL SOLVER (BETA)
# Emu version: 1.0.1
# Date: 20181229
# Description: This example demonstrates how Emu can be used to simulate the formation
# process of an elastic gridshell and visualize bi-axial moments and torsion caused
# by internal stresses as diagrams. The structure starts out flat on the ground and is
# subsequently transformed to its erected state by pulling the support points  towards
# the middle. By using the `Lath Elements`, moments are not being transferred between
# the two directions of the grid, simulating a scissor like behavior in the nodes.
# 
# www.emilpoulsen.com/emu
size_of_grid = Slider(5, range=0..10)

# ---- group: Generarate flat grid geometry
neg = Negative(Value=size_of_grid)
dom = ConstructDomain(DomainStart=neg, DomainEnd=size_of_grid)
rectangle = Rectangle(Plane=PlaneXY(0, 0, 0), XSize=dom, YSize=dom, Radius=0)  # -> Rectangle, Length
multiplication = Multiplication(A=size_of_grid, B=2)
area = Area(Geometry=rectangle.Rectangle)  # -> Area, Centroid
crv = Curve(rectangle.Rectangle)
subtraction = Subtraction(A=multiplication, B=-1)
explode = Explode(Curve=crv, Recursive=True)  # -> Segments, Vertices
series = Series(Start=0, Step=1, Count=subtraction)
# Instructions:
# 1. Hit the rebuild button connected to the model component.
# 2. Set the "Support location" slider to 1.
# 3. The DiagramViewer is blocked by a Data Dam component to make the simulation run faster.
# 4. Double click on the Timer component to start the simulation.
# 5. Move the "Support location" slider to 0.5 (carefully and not too fast!). This will move the supports
#     towards the centroid.
# 6. When the simulation has converged (when nothing is moving and the residual forces/moments
#     approach zero), double click again on the Timer component to stop the simulation.
# 7. Now enable the DiagramViewer component by hitting play on the data dam to visualize bi-axial bending and torsion.
# 
# Extra:
# 8. Change the Element Type in the Diagram Viewer to view moments about different axes (minor/major/torsion).
# 9. Use the Element Index selector to visualize diagrams of two different groups representing the two directions of the grid.
item = ListItem(List=explode.Segments, Index=3, Wrap=True)
item_2 = ListItem(List=explode.Segments, Index=0, Wrap=True)
X = UnitX(Factor=series)
Y = UnitY(Factor=series)
move = Move(Geometry=item, Motion=X)  # -> Geometry, Transform
move_2 = Move(Geometry=item_2, Motion=Y)  # -> Geometry, Transform
pt = Point(explode.Vertices)
num = Number(multiplication)
divide = DivideCurve(Curve=move_2.Geometry, Count=num, Kinks=False)  # -> Points, Tangents, Parameters
divide_2 = DivideCurve(Curve=move.Geometry, Count=num, Kinks=False)  # -> Points, Tangents, Parameters
pline = PolyLine(Vertices=divide_2.Points, Closed=False)
pline_2 = PolyLine(Vertices=divide.Points, Closed=False)
explode_2 = Explode(Curve=pline, Recursive=True)  # -> flatten(Segments), Vertices
explode_3 = Explode(Curve=pline_2, Recursive=True)  # -> flatten(Segments), Vertices

# ---- group: Move the support points towards the centroid of the grid
# CHANGE THIS PARAMETER
# WHILE RUNNING THE SIMULAITON
support_location = Slider(0.87, range=0..1)

# ---- group: Grid Y direction
line = Line(explode_2.Segments)

# ---- group: Centroid of grid
pt_2 = Point(area.Centroid)

# ---- group: Corners
pt_3 = Point(pt)

# ---- group: Grid X direction
line_2 = Line(explode_3.Segments)

# ----
line_3 = Line(line_2)
line_4 = Line(line)
pt_4 = Point(pt_2)
pt_5 = Point(pt_3)
merge = Merge(Data1=line_4, Data2=line_3)

# ---- group: viz initial configuration
preview = CustomPreview(Geometry=merge, Shader=ColourSwatch(SwatchColor=RGB(176, 159, 238)))

# ---- group: index for material/section properties
panel = Panel("1")

# ---- group: small point load to of 1 kN to get the structure initial deformation
_10º = PowerOf10(Value=Slider(3, range=0..1000))
Z = UnitZ(Factor=_10º)
pointload = PointLoad(Position=pt_4, Force=Z, Index="1")

# ---- group: Pinned supports
pt_6 = Point(pt_5)
cull_i = CullIndex(List=pt_6, Indices=0, Wrap=True)
scale = Scale(Geometry=cull_i, Center=Point(0, 0, 0), Factor=support_location)  # -> Geometry, Transform
pt_7 = Point(scale.Geometry)
restraint = Restraint(
    Point=pt_7,
    TranslationalX=True,
    TranslationalY=True,
    TranslationalZ=True,
    RotationalX=False,
    RotationalY=False,
    RotationalZ=False)

# ---- group: Define material and section properties
_10º_2 = PowerOf10(Value="6")
multiplication_2 = Multiplication(A=_10º_2, B="11000")
data = Data(panel)
multiplication_3 = Multiplication(A=multiplication_2, B="0.3")
data_2 = Data(data)
data_3 = Data(data)
custommaterial = CustomMaterial(Index=data_2, Density="400", YoungsModulus=multiplication_2, ShearModulus=multiplication_3)
solidboxsection = SolidBoxSection(Index=data_3, Height_m="0.5", Width_m="0.5")  # -> Section, Area, SecondMomentOfAreaAroundX, SecondMomentOfAreaAroundY, MomentOfInertiaTorsion

# ---- group: Define the lath elements
data_4 = Data(panel)
data_5 = Data(data_4)
data_6 = Data(data_4)
lath = Lath(Lines=line_3, Material=data_5, CrossSection=data_5, Group="2")
lath_2 = Lath(Lines=line_4, Material=data_6, CrossSection=data_6, Group="1")
merge_2 = Merge(Data1=lath_2, Data2=lath)

# ---- group: 0,0,0 vector
vec = Vector(Vector(0, 0, 0))

# ---- group: viz supports
preview_2 = CustomPreview(Geometry=pt_7, Shader=ColourSwatch(SwatchColor=RGB(255, 0, 238)))

# ---- group: assemble model
model = Model(
    Elements=merge_2,
    CrossSections=solidboxsection.Section,
    Materials=custommaterial,
    Loads=pointload,
    Restraints=restraint,
    Rebuild=Button())  # -> Model, Weight_kg

# ----
data_7 = Data(model.Model)

# ---- group: Run simulation
drprop = DynamicRelaxationProperties(
    Mass=0.922,
    DeltaTime=Slider(2.51, range=0..10),
    Damping=0.95,
    IntegrationMethod=0,
    IterationsPerStep=Slider(9, range=0..100),
    EquilibriumThreshold=0.001)
data_8 = Data(data_7)
dynamicrelaxationlive = DynamicRelaxationLive(FiniteElementModel=data_8, IntegrationProperties=drprop, Reset=Button())  # -> Model, OutOfBalanceForce, OutOfBalanceMoment, MaxDisplacement_m
data_9 = Data(dynamicrelaxationlive.Model)

# ---- group: Select indices based on the elements' groups
panel_2 = Panel("2")
elementindexselector = ElementIndexSelector(FiniteElementModel=data_7, Group="1")
int = Integer(elementindexselector)

# ----
timer = Timer(TimerInterval=2, Target=dynamicrelaxationlive)  # disabled

# ---- group: Hit play when the simulation has converged
dam = DataDam(DataA=data_9, BufferDelay=10000000, BufferMode=0)

# ---- group: viz centerlines for deformed geometry
data_10 = Data(data_9)
geometryviewer = GeometryViewer(FiniteElementModel=data_10, Amplification=1)  # -> Nodes, Lines
crv_2 = Curve(geometryviewer.Lines)
preview_3 = CustomPreview(Geometry=crv_2, Shader=ColourSwatch(SwatchColor=RGB(0, 0, 0)))

# ---- group: generate diagrams of selected elements
data_11 = Data(dam)
diagramviewer = DiagramViewer(
    FiniteElementModel=data_11,
    ElementIndices=int,
    TResult=Slider(0, range=0..10),
    Scale=Slider(1, range=-1..1),
    NumDataPoints=Slider(0, range=0..100),
    Amplification=1)  # -> Diagram, Values, Loft
num_2 = Number(diagramviewer.Values)
crv_3 = Curve(diagramviewer.Diagram)
brep = Brep(diagramviewer.Loft)

# ---- group: Pa -> MPa
division = Division(A=num_2, B=1000000)

# ----
brep_2 = Brep(brep)

# ---- group: Round
multiplication_4 = Multiplication(A=division, B="100")
round = Round(Number=multiplication_4)  # -> Nearest, Floor, Ceiling
division_2 = Division(A=round.Nearest, B="100")
concat = Concatenate(FragmentA=division_2, FragmentB=" MPa")

# ---- group: Viz diagrams
swatch = ColourSwatch(SwatchColor=RGB(0, 200, 255))
material = CreateMaterial(
    Diffuse=ColourSwatch(SwatchColor=RGB(0, 0, 0)),
    Specular=swatch,
    Emission=swatch,
    Transparency=Slider(0.564, range=0..1),
    Shine=0)
preview_4 = CustomPreview(Geometry=brep_2, Shader=material)

# ---- group: Grab 2 points on the diagram for start/end moment viz
item_3 = ListItem(List=crv_3, Index=2, Wrap=True)  # -> Item, Item1
curvepoint = PointOnCurve(item_3.Item, parameter=0.75)
curvepoint_2 = PointOnCurve(item_3.Item, parameter=0.25)

# ----
merge_3 = Merge(Data1=curvepoint_2, Data2=curvepoint)

# ---- group: viz quantaties
txt = Text(concat)
tag = TextTag(Location=merge_3, Text=txt, Colour=ColourSwatch(SwatchColor=RGB(0, 0, 0)))
