# Grasshopper definition Emu_ForceDensityFlatGridStifferEdges.gh (Grasshopper 1.0.7)
# plug-ins: Emu Grasshopper, Kangaroo2 Components

# ---- group: Create grid footprint
number_slider = Slider(5, range=0..10)
# EMU STRUCTURAL SOLVER (BETA)
# Emu version: 1.3.0
# Date: 20230501
# Description: This example shows how to
# analyze a simple cable net structure using
# the Force Density solver in Emu. The ridge
# cables and interior cables can be definied
# with different stiffnesses.
# 
# www.emilpoulsen.com/emu
neg = Negative(Value=number_slider)
dom = ConstructDomain(DomainStart=neg, DomainEnd=number_slider)
rectangle = Rectangle(Plane=PlaneXY(0, 0, 0), XSize=dom, YSize=dom, Radius=0)  # -> Rectangle, Length
crv = Curve(rectangle.Rectangle)
explode = Explode(Curve=crv, Recursive=True)  # -> Segments, Vertices
corners = Point(explode.Vertices)
edge = Curve(explode.Segments)

# ---- group: Create grid geometry
edges = Curve(edge)
number_slider_2 = Slider(10, range=0..10)
divide = DivideCurve(Curve=edges, Count=number_slider_2, Kinks=False)  # -> Points, Tangents, Parameters
simplify = SimplifyTree(Tree=divide.Points, Front=False)
branch = TreeBranch(Tree=simplify, Path=Slider(0, range=0..10), MaintainPaths=True)
branch_2 = TreeBranch(Tree=simplify, Path=Slider(1, range=0..10), MaintainPaths=True)
branch_3 = TreeBranch(Tree=simplify, Path=Slider(3, range=0..10), MaintainPaths=True)
branch_4 = TreeBranch(Tree=simplify, Path=Slider(2, range=0..10), MaintainPaths=True)
ln = Line(StartPoint=branch_2, EndPoint=reverse(branch_3))
ln_2 = Line(StartPoint=branch, EndPoint=reverse(branch_4))
num = Number(number_slider_2)
divide_2 = DivideCurve(Curve=ln_2, Count=num, Kinks=False)  # -> Points, Tangents, Parameters
divide_3 = DivideCurve(Curve=ln, Count=num, Kinks=False)  # -> Points, Tangents, Parameters
pline = PolyLine(Vertices=divide_2.Points, Closed=False)  # -> flatten(Polyline)
pline_2 = PolyLine(Vertices=divide_3.Points, Closed=False)  # -> flatten(Polyline)
number_slider_3 = Slider(0, range=0..100)
number_slider_4 = Slider(0, range=0..100)
cull_i = CullIndex(List=pline, Indices=number_slider_3, Wrap=True)
cull_i_2 = CullIndex(List=pline_2, Indices=number_slider_4, Wrap=True)
explode_2 = Explode(Curve=pline, Recursive=True)  # -> Segments, Vertices
cull_i_3 = CullIndex(List=reverse(cull_i), Indices=number_slider_3, Wrap=True)
cull_i_4 = CullIndex(List=reverse(cull_i_2), Indices=number_slider_4, Wrap=True)
divide_4 = DivideCurve(Curve=edges, Count=Slider(10, range=0..10), Kinks=False)  # -> Points, Tangents, Parameters
explode_3 = Explode(Curve=cull_i_3, Recursive=True)  # -> Segments, Vertices
explode_4 = Explode(Curve=cull_i_4, Recursive=True)  # -> Segments, Vertices
pline_3 = PolyLine(Vertices=divide_4.Points, Closed=False)
explode_5 = Explode(Curve=pline_3, Recursive=True)  # -> Segments, Vertices
merge = Merge(Data1=explode_3.Segments, Data2=explode_4.Segments)
outer_elemens = Curve(flatten(explode_5.Segments))
inner_elements = Curve(flatten(merge))
grid_nodes = Point(explode_2.Vertices)

# ---- group: Visualize elements
preview = CustomPreview(Geometry=[inner_elements, outer_elemens], Shader=ColourSwatch(SwatchColor=RGB(176, 159, 238)))

# ---- group: Define supports
supports = Point(corners)
duppt = RemoveDuplicatePts(Points=supports, Tolerance=0.01)
restraint = Restraint(
    Point=duppt,
    TranslationalX=True,
    TranslationalY=True,
    TranslationalZ=True,
    RotationalX=False,
    RotationalY=False,
    RotationalZ=False)

# ---- group: Define vertical point loads / grid nodes
pt = Point(grid_nodes)

# ---- group: Create bars/cables of inner and outer elements / inner elements
crv_2 = Curve(inner_elements)

# ---- group: Create bars/cables of inner and outer elements / outer elements
crv_3 = Curve(outer_elemens)

# ---- group: Define vertical point loads
# Change this parameter to adjust vertical force!
duppt_2 = RemoveDuplicatePts(Points=pt, Tolerance=0.01)  # -> flatten(UniquePoints)
vec = VectorXYZ(XComponent=0, YComponent=0, ZComponent=Slider(0.367, range=0..1))  # -> Vector, Length
pointload = PointLoad(Position=duppt_2, Force=vec.Vector, Index=0)

# ---- group: Visualize supports
dots = DotDisplay(Point=duppt, Colour=ColourSwatch(SwatchColor=RGB(0, 200, 255)), Size=Slider(0.1, range=0..1))

# ---- group: Create bars/cables of inner and outer elements
bar = Bar(Lines=crv_2, Group="0")
bar_2 = Bar(Lines=crv_3, Group="1")
merge_2 = Merge(Data1=bar, Data2=bar_2)

# ---- group: Assemble model
model = Model(Elements=merge_2, Loads=pointload, Constraints=restraint, Rebuild=Button())  # -> Model, Weight_kg

# ---- group: Force densities for the element groups. This is defined by the "Group" input in the "Bar" components
genes = GenePool(Decimals=2, Maximum=10, Minimum=0.01, Value=[2.14, 3.06])
panel = Panel("""0
1""")
# Change these parameters to adjust force densities!
fdm_prop = ForceDensityProperties(Group=panel, ForceDensityValuesThisListWillBeMatchedWithTheGroupInputList=genes)

# ---- group: Run Force Density Solver
fdm_solver = ForceDensitySolver(FiniteElementModel=model.Model, FDMProperties=fdm_prop)  # -> Model, MaxDisplacement_m

# ---- group: Visualize results
clineview = CenterlineViewer(FiniteElementModel=fdm_solver.Model, Amplification=Slider(0.375, range=0..1))  # -> Nodes, Lines

# ----
crv_4 = Curve(clineview.Lines)

# ---- group: Visualize deformend elements
preview_2 = CustomPreview(Geometry=crv_4, Shader=ColourSwatch(SwatchColor=RGB(255, 0, 238)))
