# Grasshopper definition Emu_PlywoodStripTorsion.gh (Grasshopper 1.0.5)
# plug-ins: Emu Grasshopper

# ---- group: E (Pa, plywood)
multiplication = Multiplication(A="10200", B=Slider(1000000, range=0..1000000))

# ---- group: G (Pa, plywood)
multiplication_2 = Multiplication(A="720", B=Slider(1000000, range=0..1000000))

# ---- group: Geometry of the beam (segmented)
# EMU STRUCTURAL SOLVER (BETA)
# Emu version: 1.0.1
# Date: 20181228
# Description: This example shows how to
# analyze a clamped beam subjected to a
# torsion point load at its free end.
# 
# www.emilpoulsen.com/emu
number_slider = Slider(0.62, range=0..10)
X = UnitX(Factor=1)
pt = Point(Point(0, 0, 0))
line = LineSDL(Start=pt, Direction=X, Length=number_slider)
crv = Curve(line)
divide = DivideCurve(Curve=crv, Count=Slider(11, range=0..11), Kinks=False)  # -> Points, Tangents, Parameters
pline = PolyLine(Vertices=divide.Points, Closed=False)
explode = Explode(Curve=pline, Recursive=True)  # -> Segments, Vertices

# ----
crv_2 = Curve(crv)

# ---- group: material of beam
number_slider_2 = Slider(0.4, range=0..1)
emod = YoungsModulus(2.1e+11)
custommaterial = CustomMaterial(Density=7850, YoungsModulus=multiplication, ShearModulus=multiplication_2)

# ---- group: cross sectin of beam (thin plywood strip)
solidboxsection = SolidBoxSection(Index="0", Height_m=Slider(0.006, range=0..0.01), Width_m=Slider(0.05, range=0..0.1))  # -> Section, Area, SecondMomentOfAreaAroundX, SecondMomentOfAreaAroundY, MomentOfInertiaTorsion

# ----
toggle = BooleanToggle(True)
toggle_2 = BooleanToggle(False)

# ---- group: Define supports (pinned and roller)
end = EndPoints(Curve=crv_2)  # -> Start, End
restraint = Restraint(
    Point=end.End,
    TranslationalX=toggle_2,
    TranslationalY=toggle_2,
    TranslationalZ=toggle_2,
    RotationalX=toggle_2,
    RotationalY=toggle_2,
    RotationalZ=toggle_2)
restraint_2 = Restraint(
    Point=end.Start,
    TranslationalX=toggle,
    TranslationalY=toggle,
    TranslationalZ=toggle,
    RotationalX=toggle,
    RotationalY=toggle,
    RotationalZ=toggle)

# ---- group: nodal moment load at free end
pt_2 = Point(end.End)
vec = VectorXYZ(XComponent=Slider(19, range=0..100), YComponent=0, ZComponent=0)  # -> Vector, Length
pointload = PointLoad(Position=pt_2, Moment=vec.Vector, Index=0)

# ---- group: create beam elements
beam = Beam(Line=explode.Segments, Material=custommaterial, CrossSection=solidboxsection.Section, Group=0)

# ---- group: hit rebuild if you change the topology of the model
button = Button()

# ---- group: Assemble the model components
model = Model(Elements=beam, Loads=flatten(pointload), Constraints=[restraint_2, restraint], Rebuild=button)  # -> Model, Weight_kg

# ----
drprop = DynamicRelaxationProperties(
    Mass=0.922,
    DeltaTime=0.922,
    Damping=0.95,
    IntegrationMethod=0,
    IterationsPerStep=Slider(10, range=0..10),
    EquilibriumThreshold=0.001)

# ---- group: Double click the timer to run the simulation
timer = Timer(TimerInterval=20, Target=drsolver)  # disabled

# ----
drsolver = DynamicRelaxationSolver(FiniteElementModel=model.Model, IntegrationProperties=drprop, Reset=Button())  # -> Model, OutOfBalanceForce_N, OutOfBalanceMoment_Nm, MaxDisplacement_m
data = Data(drsolver.Model)

# ---- group: mesh extrusion of twisted mesh
sectionview = SectionViewer(FiniteElementModel=data, Amplification=Slider(2.801, range=1..5))
mesh = Mesh(sectionview)

# ---- group: show the anglular dimension
elemforceview = ElementForceViewer(FiniteElementModel=data, Stations=2)  # -> Force, Moments, Normal, CoordinateSystems
flatten = FlattenTree(Tree=elemforceview.CoordinateSystems, Path="{0}")
item = ListItem(List=reverse(flatten), Index=0, Wrap=True)
deplane = DeconstructPlane(Plane=item)  # -> Origin, XAxis, YAxis, ZAxis
number_slider_3 = Slider(0.19, range=0..1)
Y = UnitY(Factor=1)
multiplication_3 = Multiplication(A=deplane.XAxis, B=number_slider_3)
multiplication_4 = Multiplication(A=Y, B=number_slider_3)
move = Move(Geometry=deplane.Origin, Motion=multiplication_3)  # -> Geometry, Transform
move_2 = Move(Geometry=deplane.Origin, Motion=multiplication_4)  # -> Geometry, Transform
vdis = VectorDisplay(Anchor=deplane.Origin, Vector=multiplication_3)
vdis_2 = VectorDisplay(Anchor=deplane.Origin, Vector=multiplication_4)
angledim = AngularDimension(
    Center=deplane.Origin,
    PointA=move.Geometry,
    PointB=move_2.Geometry,
    Reflex=False,
    Text="{0:0.0}°",
    Size=Slider(0.035, range=0..0.1))

# ---- group: visualize diagram and quantities
data_2 = Data(data)
diagramviewer = DiagramViewer(FiniteElementModel=data_2, TResult=2, Scale=Slider(0.094, range=0..1), NumDataPoints=2, Amplification=1)  # -> Diagram, Values, Loft
crv_3 = Curve(diagramviewer.Diagram)
srf = Surface(diagramviewer.Loft)
item_2 = ListItem(List=reverse(crv_3), Index=0, Wrap=True)
number_slider_4 = Slider(4, range=0..10)
item_3 = ListItem(List=diagramviewer.Values, Index=0, Wrap=True)
curvepoint = PointOnCurve(item_2, parameter=0.5)
multiplication_5 = Multiplication(A=item_3, B=number_slider_4)
xy = XYPlane(Origin=curvepoint)
pi = Pi(Factor=-0.5)
round = Round(Number=multiplication_5)  # -> Nearest, Floor, Ceiling
rotate = Rotate(Geometry=xy, Angle=pi, Plane=curvepoint)  # -> Geometry, Transform
division = Division(A=round.Nearest, B=number_slider_4)
abs = Absolute(Value=division)
concat = Concatenate(FragmentA=abs, FragmentB=" Nm")
tag = TextTag3D(Location=rotate.Geometry, Text=concat, Size=Slider(0.023, range=0..1), Justification=7)
