# Grasshopper definition Emu_SimplySupportedBeam.gh (Grasshopper 1.0.5)
# plug-ins: Emu Grasshopper

# ---- group: Geometry of the beam (segmented)
X = UnitX(Factor=1)
# EMU STRUCTURAL SOLVER (BETA)
# Emu version: 1.0.1
# Date: 20181229
# Description: This example show how to analyze a simply
# supported beam with multuple stations and visualize
# the results both as diagram and gradient mesh.
# 
# www.emilpoulsen.com/emu
pt = Point(Point(0, 0, 0))
line = LineSDL(Start=pt, Direction=X, Length=Slider(10, range=0..10))
crv = Curve(line)
divide = DivideCurve(Curve=crv, Count=Slider(10, range=0..11), Kinks=False)  # -> Points, Tangents, Parameters
pline = PolyLine(Vertices=divide.Points, Closed=False)
explode = Explode(Curve=pline, Recursive=True)  # -> Segments, Vertices

# ---- group: define uniformly distributed load
number_slider = Slider(1000, range=0..1000)
neg = Negative(Value=number_slider)
Z = UnitZ(Factor=neg)
linearload = LinearLoad(Line=explode.Segments, Force=Z, Index=0, Local=False)

# ---- group: Properties of beam (cross section and material)
number_slider_2 = Slider(0.036, range=0..0.1)
number_slider_3 = Slider(0.4, range=0..1)
emod = YoungsModulus(2.1e+11)
custommaterial = CustomMaterial(Density=7850, YoungsModulus=emod, ShearModulus=7.8e+10)
ishapesection = IShapeSection(
    Index="IShape",
    TopFlangeWidth_m=number_slider_3,
    TopFlangeThickness_m=number_slider_2,
    BottomFlangeWidth_m=number_slider_3,
    BottomFlangeThickness_m=number_slider_2,
    WebHeight_m=Slider(0.5, range=0..1),
    WebThickness_m=number_slider_2)  # -> Section, Area, SecondMomentOfAreaAroundX, SecondMomentOfAreaAroundY, MomentOfInertiaTorsion

# ---- group: Define supports (pinned and roller)
end = EndPoints(Curve=crv)  # -> Start, End
toggle = BooleanToggle(False)
toggle_2 = BooleanToggle(False)
restraint = Restraint(
    Point=end.Start,
    TranslationalX=True,
    TranslationalY=True,
    TranslationalZ=True,
    RotationalX=Toggle(True),
    RotationalY=toggle,
    RotationalZ=toggle)
restraint_2 = Restraint(
    Point=end.End,
    TranslationalX=toggle_2,
    TranslationalY=toggle_2,
    TranslationalZ=Toggle(True),
    RotationalX=False,
    RotationalY=False,
    RotationalZ=False)

# ----
beam = Beam(Line=explode.Segments, Material=custommaterial, CrossSection=ishapesection.Section, Group=0)

# ---- group: Assemble the model components
model = Model(Elements=beam, Loads=flatten(linearload), Constraints=[restraint_2, restraint], Rebuild=Button())  # -> Model, Weight_kg

# ---- group: Analyze the model using regular FEM
matrixstiffnesssolver = MatrixStiffnessSolver(FiniteElementModel=model.Model)  # -> Model, MaxDisplacement_m

# ---- group: Compare analytical and Emu results (deflection)
num = Number(number_slider)
num_2 = Number(emod)
crv_2 = Curve(crv)
num_3 = Number(ishapesection.SecondMomentOfAreaAroundX)
data = Data(matrixstiffnesssolver.MaxDisplacement_m)
len = Length(Curve=crv_2)
expression = Expression(W=num, L=len, E=num_2, I=num_3, Expression="(5*W*L^4)/(384*E*I)")
max_deflection_analytical = Panel(expression)
max_deflection_emu = Panel(data)

# ---- group: Visualize results as extruded meshes with results as color gradient
data_2 = Data(matrixstiffnesssolver.Model)
number_slider_4 = Slider(2500, range=0..10000)
elemforceview = ElementForceViewer(FiniteElementModel=data_2, Stations=2)  # -> Force, Moments, Normal, CoordinateSystems
sectionview = SectionViewer(FiniteElementModel=data_2, Amplification=number_slider_4)
pdecon = Deconstruct(Point=elemforceview.Moments)  # -> XComponent, YComponent, ZComponent
mesh = Mesh(sectionview)
mesh_2 = Mesh(mesh)

# ---- group: Compare analytical and Emu results (moment)
num_4 = Number(number_slider)
crv_3 = Curve(crv)
num_5 = Number(pdecon.XComponent)
len_2 = Length(Curve=crv_3)
flatten = FlattenTree(Tree=num_5, Path="{0}")
sort = SortList(Keys=flatten)  # -> Keys, ValuesA
expression_2 = Expression(W=num_4, L=len_2, Expression="(W*L^2)/(8)")
item = ListItem(List=sort.Keys, Index=0, Wrap=True)
abs = Absolute(Value=item)
max_moment_analytical = Panel(expression_2)
max_moment_emu = Panel(abs)

# ----
num_6 = Number(number_slider_4)
data_3 = Data(data_2)
diagramviewer = DiagramViewer(FiniteElementModel=data_3, TResult=0, Scale=1, NumDataPoints=2, Amplification=num_6)  # -> Diagram, Values, Loft

abs_2 = Absolute(Value=pdecon.XComponent)

# ---- group: Visualize results as extruded meshes with results as color gradient (continued)
num_7 = Number(abs_2)
meshviz = ResultsOnMeshViz(data=num_7, mesh=mesh_2)

# ---- group: diagrams
crv_4 = Curve(diagramviewer.Diagram)
srf = Surface(diagramviewer.Loft)

# ---- group: mesh extrusion
mesh_3 = Mesh(meshviz)

# ==== cluster ResultsOnMeshViz: Visualize structural data on a beam mesh.
data = ClusterInput()  # Structural data to visualize on the given mesh.
mesh = ClusterInput()  # Mesh to map the structural data to.
num = Number(data)
mesh_2 = Mesh(mesh)
item = ListItem(List=num, Index="0", Wrap=True)  # -> Item1, Item
merge = Merge(Data1=item.Item, Data2=item.Item1)
data_2 = Data(merge)
sort = SortList(Keys=flatten(data_2))  # -> Keys, ValuesA
item_2 = ListItem(List=sort.Keys, Index=0, Wrap=True)
item_3 = ListItem(List=reverse(sort.Keys), Index=0, Wrap=True)
gradient = Gradient(
    LowerLimit=item_2,
    UpperLimit=item_3,
    Parameter=merge,
    stops=[0: RGB(0, 0, 255), 0: RGB(0, 0, 255), 0.236: RGB(0, 255, 255), 0.497: RGB(0, 255, 0), 0.751: RGB(255, 255, 0), 1: RGB(255, 0, 0)])
mcol = MeshColours(Mesh=mesh_2, Colours=gradient)
mesh_3 = Mesh(mcol)
mesh_4 = ClusterOutput(mesh_3)  # Mesh colored by the structural data.
