# Grasshopper definition Emu_SpaceTruss.gh (Grasshopper 1.0.5)
# plug-ins: Emu Grasshopper

depth = Slider(7, range=0..10)
num_div = Slider(12, range=0..50)
# EMU STRUCTURAL SOLVER (BETA)
# Emu version: 1.0.1
# Date: 20181229
# Description: This example shows how to
# analyze a 3D truss with large deformations
# using the DR solver and visualize the
# normal forces on the displaced configuration.
# 
# www.emilpoulsen.com/emu
length = Slider(100, range=0..100)
width = Slider(10, range=0..100)

# ---- group: Generate geometry of the truss
num = Number(width)
num_2 = Number(num_div)
length_2 = Number(length)
num_3 = Number(depth)
pt = ConstructPoint(XCoordinate=0, YCoordinate=0, ZCoordinate=0)
pt_2 = ConstructPoint(XCoordinate=length_2, YCoordinate=0, ZCoordinate=0)
ln = Line(StartPoint=pt, EndPoint=pt_2)  # -> flatten(Line)
offset = Offset(Curve=ln, Distance=num, Plane=PlaneXY(0, 0, 0), Corners=1)  # -> flatten(Curve)
number_slider = Slider(1, range=0..1)
divide = DivideCurve(Curve=ln, Count=num_2, Kinks=False)  # -> Points, Tangents, Parameters
divide_2 = DivideCurve(Curve=offset, Count=num_2, Kinks=False)  # -> Points, Tangents, Parameters
end = EndPoints(Curve=[offset, ln])  # -> Start, End
shatter = Shatter(Curve=ln, Parameters=divide.Parameters)
shatter_2 = Shatter(Curve=offset, Parameters=divide_2.Parameters)
ln_2 = Line(StartPoint=divide.Points, EndPoint=divide_2.Points)
neg = Negative(Value=number_slider)
shift = ShiftList(List=ln_2, Shift=number_slider, Wrap=False)  # -> graft(List)
shift_2 = ShiftList(List=ln_2, Shift=neg, Wrap=False)  # -> graft(List)
pt_3 = Point([end.Start, end.End])
loft = Loft(
    Curves=[shift, shift_2],
    Options={Adjust=False, Closed=False, LoftEnds=0, LoftSimp=0, LoftType=0, Rebuild=10, Refit=0.01})
end_2 = EndPoints(Curve=[shift, shift_2])  # -> Start, End
neg_2 = Negative(Value=num_3)
pt_4 = Point([divide.Points, divide_2.Points])
area = Area(Geometry=loft)  # -> Area, Centroid
pt_5 = Point(simplify([end_2.Start, end_2.End]))
Z = UnitZ(Factor=neg_2)
move = Move(Geometry=area.Centroid, Motion=Z)  # -> simplify(Geometry), Transform
pline = PolyLine(Vertices=flatten(move.Geometry), Closed=False)
ln_3 = Line(StartPoint=pt_5, EndPoint=move.Geometry)  # -> flatten(Line)
explode = Explode(Curve=pline, Recursive=True)  # -> Segments, Vertices
crv = Curve(shatter_2)
crv_2 = Curve(shatter)
crv_3 = Curve(ln_2)
crv_4 = Curve(ln_3)
crv_5 = Curve(explode.Segments)
merge = Merge(Data1=crv_2, Data2=crv, Data3=crv_3, Data4=crv_4, Data5=crv_5)  # -> flatten(Result)

# ----
pt_6 = Point(pt_4)

# ---- group: Define point load at every node
pt_7 = Point(pt_6)
_10º = PowerOf10(Value=Slider(8, range=0..10))
neg_3 = Negative(Value=_10º)
multiplication = Multiplication(A=neg_3, B=Slider(0.96, range=0..10))
Z_2 = UnitZ(Factor=multiplication)
neg_4 = Negative(Value=Z_2)
pointload = PointLoad(Position=pt_7, Force=neg_4, Index=0)

# ---- group: Define cross section
circularsection = CircularSection(Index="tube", OuterRadius=Slider(0.31, range=0..1), Thickness=Slider(0.05, range=0..0.1))  # -> Section, Area, SecondMomentOfArea

# ---- group: Create bar elements
crv_6 = Curve(merge)
line = Line(crv_6)
bar = CreateBar(Line=line, Material="tube", CrossSection="tube", Group=0)

# ---- group: Define pinned supports
toggle = BooleanToggle(True)
toggle_2 = BooleanToggle(False)
const = Constraint(
    Point=pt_3,
    TranslationalX=toggle,
    TranslationalY=toggle,
    TranslationalZ=toggle,
    RotationalX=toggle_2,
    RotationalY=toggle_2,
    RotationalZ=toggle_2)

# ----
custommaterial = CustomMaterial(Index="tube", Density=7850, YoungsModulus=2.1e+11, PoissonsRatio=0.3)

# ---- group: Assemble model
model = Model(
    Elements=bar,
    CrossSections=circularsection.Section,
    Materials=custommaterial,
    Loads=pointload,
    Constraints=const,
    Rebuild=Button())  # -> Model, Weight_kg

# ---- group: Run simulation
drprop = DynamicRelaxationProperties(
    Mass=0.922,
    DeltaTime=Slider(2, range=0..10),
    Damping=0.95,
    IntegrationMethod=0,
    IterationsPerStep=Slider(20, range=0..100),
    EquilibriumThreshold=0.001)
dynamicrelaxationlive = DynamicRelaxationLive(FiniteElementModel=model.Model, IntegrationProperties=drprop, Reset=False)  # -> Model, OutOfBalanceForce, OutOfBalanceMoment, MaxDisplacement_m
timer = Timer(TimerInterval=1, Target=dynamicrelaxationlive)  # disabled
panel = Panel([dynamicrelaxationlive.OutOfBalanceForce, dynamicrelaxationlive.OutOfBalanceMoment])

# ---- group: Visualize reaction forces
reactforce = ReactionForces(FiniteElementModel=dynamicrelaxationlive.Model)  # -> Location, Forces, Moments, Vertical
_10º_2 = PowerOf10(Value=Slider(8, range=0..10))
one_over_x = OneOverX(Value=_10º_2)
multiplication_2 = Multiplication(A=reactforce.Forces, B=one_over_x)
vdis = VectorDisplay(Anchor=reactforce.Location, Vector=multiplication_2)

# ---- group: Visualize normal forces
data = Data(dynamicrelaxationlive.Model)
elemforceview = ElementForceViewer(FiniteElementModel=data, Stations=2)  # -> Force, Moments, Normal, CoordinateSystems
data_2 = Data(elemforceview.Normal)
sectionview = SectionViewer(FiniteElementModel=data, Amplification=1)
sort = SortList(Keys=flatten(data_2))  # -> Keys, ValuesA
item = ListItem(List=sort.Keys, Index=0, Wrap=True)  # -> Item1, Item
panel_2 = Panel(item.Item1)
panel_3 = Panel(item.Item)
gradient = Gradient(LowerLimit=item.Item1, UpperLimit=item.Item, Parameter=data_2, stops=[0: RGB(0, 0, 255), 1: RGB(255, 0, 0)])
mcol = MeshColours(Mesh=sectionview, Colours=gradient)
